# Grasshopper definition DEFFieParser非常重要.ghx (Grasshopper 1.0.7)
# plug-ins: TransmissionGIM23DM

A = Slider(50, range=0..100)
B = Slider(50, range=0..100)
C = Slider(50, range=0..100)
inputpart = InputPart(
    FHOD_1=Slider(0.001, range=0..0.1),
    FHOD_2=Slider(0.001, range=0..0.1),
    FHT_1=Slider(0.001, range=0..0.1),
    FHT_2=Slider(0.001, range=0..0.1),
    FMGW_1=Slider(0.001, range=0..0.1),
    FMGW_2=Slider(0.001, range=0..0.1),
    FPSO_1=Slider(0.001, range=0..0.1),
    FPSO_2=Slider(0.001, range=0..0.1),
    POD_1=Slider(0.001, range=0..0.1),
    POD_2=Slider(0.001, range=0..0.1),
    PID_1=Slider(0.001, range=0..0.1),
    PID_2=Slider(0.001, range=0..0.1),
    RFSD_1=Slider(0.001, range=0..0.1),
    RFSD_2=Slider(0.001, range=0..0.1),
    RWT_1=Slider(0.001, range=0..0.1),
    RWT_2=Slider(0.001, range=0..0.1),
    SGSD_1=Slider(0.001, range=0..0.1),
    SGSD_2=Slider(0.001, range=0..0.1),
    WTGS_1=Slider(0.001, range=0..0.1),
    WTGS_2=Slider(0.001, range=0..0.1),
    NPD_1=Slider(0.001, range=0..0.1),
    NPD_2=Slider(0.001, range=0..0.1),
    INSULTHK=Slider(0.001, range=0..0.1))  # -> FHOD_1, FHOD_2, FHT_1, FHT_2, FMGW_1, FMGW_2, FPSO_1, FPSO_2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
parameter = Parameter(X=A)  # -> Param, Code
parameter_2 = Parameter(X=B)  # -> Param, Code
parameter_3 = Parameter(X=C)  # -> Param, Code
deffilepath = FilePath("C:\Users\jinha\Desktop\GlobeValve.def")
deffileparser = CSharpScript(
    DEFFilePath=deffilepath,
    Reference=["C:\Users\jinha\AppData\Roaming\Grasshopper\Libraries\SIM2DEF.gha", "C:\Users\jinha\AppData\Roaming\Grasshopper\Libraries\Debug\net48\TransmissionGIM23DM.gha"])  # inputs DEFFilePath: String
# ---------- deffileparser: C# usings ----------
using System.IO;
using TransmissionGIM23DM;
using System.Text.RegularExpressions;
using System.Drawing;
using Grasshopper.Kernel.Special;
using System.Linq;
# ---------- deffileparser: C# ----------
    List < string > DEFFileStrings = GetDEFFileStrings(DEFFilePath);
    GH_Document GrasshopperDocument = Instances.ActiveCanvas.Document;

    Dictionary < string, TransmissionGIM23DM.Parameter > Parameters = new Dictionary < string, TransmissionGIM23DM.Parameter>(){};
    int ParameterCount = 0;
    foreach(string i in DEFFileStrings)
    {
      if (i.Contains("@Param"))
      {
        float myParameterX = Convert.ToSingle(0);
        float myParameterY = Convert.ToSingle(100 * ParameterCount);
        TransmissionGIM23DM.Parameter myParameter = new TransmissionGIM23DM.Parameter();
        GrasshopperDocument.AddObject(myParameter, false);
        myParameter.Attributes.Pivot = new PointF(myParameterX, myParameterY);
        myParameter.Params.Input[0].NickName = i.Split(' ')[2];

        //GH_Panel myPanel = new GH_Panel();
        //GrasshopperDocument.AddObject(myPanel, false);
        //myPanel.Attributes.Pivot = new PointF(myParameterX - 200, myParameterY - 10);
        //myPanel.UserText = "100";
        //myPanel.Attributes.Bounds = new RectangleF(0.0F, 0.0F, 100.0F, 20.0F);
        //myPanel.Attributes.ExpireLayout();
        //myParameter.Params.Input[0].AddSource(myPanel);

        GH_NumberSlider mySlider = new GH_NumberSlider();
        GrasshopperDocument.AddObject(mySlider, false);
        mySlider.Attributes.Pivot = new PointF(myParameterX - 500, myParameterY - 10);
        mySlider.NickName = i.Split(' ')[2];
        mySlider.Slider.Maximum = 100M;
        mySlider.Slider.Minimum = 0M;
        decimal temp = 50M;
        mySlider.SetSliderValue(temp);
        myParameter.Params.Input[0].AddSource(mySlider);


        Parameters[i.Split(' ')[2]] = myParameter;
        ParameterCount = ParameterCount + 1;
      }
    }

    float OtherParameterX = Convert.ToSingle(0);
    float OtherParameterY = Convert.ToSingle(100 * ParameterCount);
    TransmissionGIM23DM.InputPart2 OtherParameter = new TransmissionGIM23DM.InputPart2();
    GrasshopperDocument.AddObject(OtherParameter, false);
    for(int i = 0; i < OtherParameter.Params.Output.Count; i++)
    {
      GH_NumberSlider mySlider = new GH_NumberSlider();
      GrasshopperDocument.AddObject(mySlider, false);
      mySlider.Attributes.Pivot = new PointF(OtherParameterX - 500, OtherParameterY - 30 + i * 20);
      mySlider.Slider.Maximum = 0.1M;
      mySlider.Slider.Minimum = 0M;
      decimal temp = 0.001M;
      mySlider.SetSliderValue(temp);
      OtherParameter.Params.Input[i].AddSource(mySlider);
    }

    OtherParameter.Attributes.Pivot = new PointF(OtherParameterX, OtherParameterY + 200);

    Dictionary < string, TransmissionGIM23DM.Position > Positions = new Dictionary < string, TransmissionGIM23DM.Position>(){};
    int PositionCount = 0;
    foreach(string i in DEFFileStrings)
    {
      if (i.Contains("@Define_Posi"))
      {
        List<string> DefineNameXYZ = i.Split(' ').ToList();
        float myPositionX = Convert.ToSingle(1200);
        float myPositionY = Convert.ToSingle(700 * PositionCount);
        TransmissionGIM23DM.Position myPosition = new TransmissionGIM23DM.Position();
        GrasshopperDocument.AddObject(myPosition, false);

        myPosition.Attributes.Pivot = new PointF(myPositionX, myPositionY);
        GH_Panel myPanel = new GH_Panel();
        GrasshopperDocument.AddObject(myPanel, false);
        myPanel.Attributes.Pivot = new PointF(myPositionX - 400, myPositionY - 40);
        myPanel.UserText = DefineNameXYZ[1];
        myPanel.Attributes.Bounds = new RectangleF(0.0F, 0.0F, 100.0F, 20.0F);
        myPanel.Attributes.ExpireLayout();

        myPosition.Params.Input[0].AddSource(myPanel);

        for(int j = 0;j < 3;j++)
        {

          if (TextIsNumber(DefineNameXYZ[j + 2]))
          {
            myPosition.Params.Input[j + 1].AddVolatileData(new Grasshopper.Kernel.Data.GH_Path(0), 0, Convert.ToDouble(DefineNameXYZ[j + 2]));
          }
          else
          {
            TransmissionGIM23DM.Formula myFormula = new TransmissionGIM23DM.Formula();
            GrasshopperDocument.AddObject(myFormula, false);
            myFormula.Attributes.Pivot = new PointF(myPositionX - 400, myPositionY + 100 + 200 * j);
            GH_Panel myFormulaPanel = new GH_Panel();
            GrasshopperDocument.AddObject(myFormulaPanel, false);
            myFormulaPanel.Attributes.Pivot = new PointF(myPositionX - 800, myPositionY + 130 + 200 * j);
            myFormulaPanel.UserText = DefineNameXYZ[j + 2];
            myFormulaPanel.Attributes.Bounds = new RectangleF(0.0F, 0.0F, 100.0F, 20.0F);
            myFormulaPanel.Attributes.ExpireLayout();
            myFormula.Params.Input[4].AddSource(myFormulaPanel);
            myPosition.Params.Input[j + 1].AddSource(myFormula.Params.Output[0]);
            int myFormulaCount = 0;
            foreach (string item in Parameters.Keys)
            {
              if (DefineNameXYZ[j + 2].Contains(item))
              {
                myFormula.Params.Input[myFormulaCount].AddSource(Parameters[item].Params.Output[0]);
                myFormulaCount++;
              }
            }
            foreach(var item in OtherParameter.Params.Output)
            {
              if (DefineNameXYZ[j + 2].Contains(item.Name))
              {
                myFormula.Params.Input[myFormulaCount].AddSource(item);
                myFormulaCount++;
              }
            }
          }
        }

        Positions[DefineNameXYZ[1]] = myPosition;
        PositionCount = PositionCount + 1;
      }
    }

    Dictionary < string, TransmissionGIM23DM.Vector > Vectors = new Dictionary < string, TransmissionGIM23DM.Vector>(){};
    int VectorCount = 0;
    foreach(string i in DEFFileStrings)
    {
      if (i.Contains("@Define_Vect"))
      {
        List<string> DefineNameXYZABC = i.Split(' ').ToList();
        float myVectorX = Convert.ToSingle(2300);
        float myVectorY = Convert.ToSingle(300 * VectorCount);
        TransmissionGIM23DM.Vector myVector = new TransmissionGIM23DM.Vector();
        GrasshopperDocument.AddObject(myVector, false);

        myVector.Attributes.Pivot = new PointF(myVectorX, myVectorY);
        GH_Panel myPanel = new GH_Panel();
        GrasshopperDocument.AddObject(myPanel, false);
        myPanel.Attributes.Pivot = new PointF(myVectorX - 200, myVectorY - 70);
        myPanel.UserText = DefineNameXYZABC[1];
        myPanel.Attributes.Bounds = new RectangleF(0.0F, 0.0F, 100.0F, 20.0F);
        myPanel.Attributes.ExpireLayout();
        myVector.Params.Input[0].AddSource(myPanel);
        for(int k = 2; k < 8;k++)
        {
          if (DefineNameXYZABC[k].Contains("+"))
          {
            DefineNameXYZABC[k] = DefineNameXYZABC[k].Replace("+", "");
          }
          myVector.Params.Input[k - 1].AddVolatileData(new Grasshopper.Kernel.Data.GH_Path(0), 0, Convert.ToDouble(DefineNameXYZABC[k]));
        }
        Vectors[DefineNameXYZABC[1]] = myVector;
        VectorCount = VectorCount + 1;
      }
    }

    int CSGCount = 0;
    foreach(string i in DEFFileStrings)
    {
      if (i.Contains("@Add_"))
      {
        float myCSGX = Convert.ToSingle(4300);
        float myCSGY = Convert.ToSingle(400 * CSGCount);
        if (i.Contains("Cylinder"))
        {
          TransmissionGIM23DM.Cylinder myCSG = new TransmissionGIM23DM.Cylinder();
          GrasshopperDocument.AddObject(myCSG, false);

          myCSG.Attributes.Pivot = new PointF(myCSGX, myCSGY);

          foreach (string item in Positions.Keys)
          {
            if (i.Split(' ')[1] == item)
            {
              myCSG.Params.Input[0].AddSource(Positions[item].Params.Output[0]);
            }
          }
          foreach (string item in Vectors.Keys)
          {
            if (i.Split(' ')[2] == item)
            {
              myCSG.Params.Input[1].AddSource(Vectors[item].Params.Output[0]);
            }
          }
          for(int k = 3; k < i.Split(' ').Length; k++)
          {
            TransmissionGIM23DM.Formula myFormula = new TransmissionGIM23DM.Formula();
            GrasshopperDocument.AddObject(myFormula, false);
            myFormula.Attributes.Pivot = new PointF(myCSGX - 400, myCSGY + 100 + 200 * (k - 3));
            GH_Panel myFormulaPanel = new GH_Panel();
            GrasshopperDocument.AddObject(myFormulaPanel, false);
            myFormulaPanel.Attributes.Pivot = new PointF(myCSGX - 800, myCSGY + 130 + 200 * (k - 3));
            myFormulaPanel.UserText = i.Split(' ')[k];
            myFormulaPanel.Attributes.Bounds = new RectangleF(0.0F, 0.0F, 100.0F, 20.0F);
            myFormulaPanel.Attributes.ExpireLayout();
            myFormula.Params.Input[4].AddSource(myFormulaPanel);
            myCSG.Params.Input[k - 1].AddSource(myFormula.Params.Output[0]);
            int myFormulaCount = 0;
            foreach (string item in Parameters.Keys)
            {
              if (i.Split(' ')[k].Contains(item))
              {
                myFormula.Params.Input[myFormulaCount].AddSource(Parameters[item].Params.Output[0]);
                myFormulaCount++;
              }
            }
            foreach(var item in OtherParameter.Params.Output)
            {
              if (i.Split(' ')[k].Contains(item.Name))
              {
                myFormula.Params.Input[myFormulaCount].AddSource(item);
                myFormulaCount++;
              }
            }
          }
          CSGCount = CSGCount + 1;
        }

        if (i.Contains("Cone"))
        {
          TransmissionGIM23DM.Cone myCSG = new TransmissionGIM23DM.Cone();
          GrasshopperDocument.AddObject(myCSG, false);

          myCSG.Attributes.Pivot = new PointF(myCSGX, myCSGY);

          foreach (string item in Positions.Keys)
          {
            if (i.Split(' ')[1] == item)
            {
              myCSG.Params.Input[0].AddSource(Positions[item].Params.Output[0]);
            }
          }
          foreach (string item in Vectors.Keys)
          {
            if (i.Split(' ')[2] == item)
            {
              myCSG.Params.Input[1].AddSource(Vectors[item].Params.Output[0]);
            }
          }
          for(int k = 3; k < i.Split(' ').Length; k++)
          {
            TransmissionGIM23DM.Formula myFormula = new TransmissionGIM23DM.Formula();
            GrasshopperDocument.AddObject(myFormula, false);
            myFormula.Attributes.Pivot = new PointF(myCSGX - 400, myCSGY + 100 + 200 * (k - 3));
            GH_Panel myFormulaPanel = new GH_Panel();
            GrasshopperDocument.AddObject(myFormulaPanel, false);
            myFormulaPanel.Attributes.Pivot = new PointF(myCSGX - 800, myCSGY + 130 + 200 * (k - 3));
            myFormulaPanel.UserText = i.Split(' ')[k];
            myFormulaPanel.Attributes.Bounds = new RectangleF(0.0F, 0.0F, 100.0F, 20.0F);
            myFormulaPanel.Attributes.ExpireLayout();
            myFormula.Params.Input[4].AddSource(myFormulaPanel);
            myCSG.Params.Input[k - 1].AddSource(myFormula.Params.Output[0]);
            int myFormulaCount = 0;
            foreach (string item in Parameters.Keys)
            {
              if (i.Split(' ')[k].Contains(item))
              {
                myFormula.Params.Input[myFormulaCount].AddSource(Parameters[item].Params.Output[0]);
                myFormulaCount++;
              }
            }
            foreach(var item in OtherParameter.Params.Output)
            {
              if (i.Split(' ')[k].Contains(item.Name))
              {
                myFormula.Params.Input[myFormulaCount].AddSource(item);
                myFormulaCount++;
              }
            }
          }
          CSGCount = CSGCount + 1;
        }

        if (i.Contains("CircleTorus"))
        {
          TransmissionGIM23DM.CircleTorus myCSG = new TransmissionGIM23DM.CircleTorus();
          GrasshopperDocument.AddObject(myCSG, false);

          myCSG.Attributes.Pivot = new PointF(myCSGX, myCSGY);

          foreach (string item in Positions.Keys)
          {
            if (i.Split(' ')[1] == item)
            {
              myCSG.Params.Input[0].AddSource(Positions[item].Params.Output[0]);
            }
          }
          foreach (string item in Vectors.Keys)
          {
            if (i.Split(' ')[2] == item)
            {
              myCSG.Params.Input[1].AddSource(Vectors[item].Params.Output[0]);
            }
          }
          for(int k = 3; k < i.Split(' ').Length; k++)
          {
            if (TextIsNumber(i.Split(' ')[k]))
            {
              GH_Panel myFormulaPanel = new GH_Panel();
              GrasshopperDocument.AddObject(myFormulaPanel, false);
              myFormulaPanel.Attributes.Pivot = new PointF(myCSGX - 200, myCSGY + 100 * (k - 3));
              myFormulaPanel.UserText = i.Split(' ')[k];
              myFormulaPanel.Description = i.Split(' ')[k];
              myFormulaPanel.Attributes.Bounds = new RectangleF(0.0F, 0.0F, 100.0F, 20.0F);
              myFormulaPanel.Attributes.ExpireLayout();
              myCSG.Params.Input[k - 1].AddSource(myFormulaPanel);
            }
            else
            {
              TransmissionGIM23DM.Formula myFormula = new TransmissionGIM23DM.Formula();
              GrasshopperDocument.AddObject(myFormula, false);
              myFormula.Attributes.Pivot = new PointF(myCSGX - 400, myCSGY + 100 + 200 * (k - 3));
              GH_Panel myFormulaPanel = new GH_Panel();
              GrasshopperDocument.AddObject(myFormulaPanel, false);
              myFormulaPanel.Attributes.Pivot = new PointF(myCSGX - 800, myCSGY + 130 + 200 * (k - 3));
              myFormulaPanel.UserText = i.Split(' ')[k];
              myFormulaPanel.Attributes.Bounds = new RectangleF(0.0F, 0.0F, 100.0F, 20.0F);
              myFormulaPanel.Attributes.ExpireLayout();
              myFormula.Params.Input[4].AddSource(myFormulaPanel);
              myCSG.Params.Input[k - 1].AddSource(myFormula.Params.Output[0]);
              int myFormulaCount = 0;
              foreach (string item in Parameters.Keys)
              {
                if (i.Split(' ')[k].Contains(item))
                {
                  myFormula.Params.Input[myFormulaCount].AddSource(Parameters[item].Params.Output[0]);
                  myFormulaCount++;
                }
              }
              foreach(var item in OtherParameter.Params.Output)
              {
                if (i.Split(' ')[k].Contains(item.Name))
                {
                  myFormula.Params.Input[myFormulaCount].AddSource(item);
                  myFormulaCount++;
                }
              }
            }
          }
          CSGCount = CSGCount + 1;
        }
        
        if (i.Contains("Sphere"))
        {
          TransmissionGIM23DM.Sphere myCSG = new TransmissionGIM23DM.Sphere();
          GrasshopperDocument.AddObject(myCSG, false);

          myCSG.Attributes.Pivot = new PointF(myCSGX, myCSGY);

          foreach (string item in Positions.Keys)
          {
            if (i.Split(' ')[1] == item)
            {
              myCSG.Params.Input[0].AddSource(Positions[item].Params.Output[0]);
            }
          }
          foreach (string item in Vectors.Keys)
          {
            if (i.Split(' ')[2] == item)
            {
              myCSG.Params.Input[1].AddSource(Vectors[item].Params.Output[0]);
            }
          }
          for(int k = 3; k < i.Split(' ').Length; k++)
          {
            if (TextIsNumber(i.Split(' ')[k]))
            {
              GH_Panel myFormulaPanel = new GH_Panel();
              GrasshopperDocument.AddObject(myFormulaPanel, false);
              myFormulaPanel.Attributes.Pivot = new PointF(myCSGX - 200, myCSGY + 100 * (k - 3));
              myFormulaPanel.UserText = i.Split(' ')[k];
              myFormulaPanel.Description = i.Split(' ')[k];
              myFormulaPanel.Attributes.Bounds = new RectangleF(0.0F, 0.0F, 100.0F, 20.0F);
              myFormulaPanel.Attributes.ExpireLayout();
              myCSG.Params.Input[k - 1].AddSource(myFormulaPanel);
            }
            else
            {
              TransmissionGIM23DM.Formula myFormula = new TransmissionGIM23DM.Formula();
              GrasshopperDocument.AddObject(myFormula, false);
              myFormula.Attributes.Pivot = new PointF(myCSGX - 400, myCSGY + 100 + 200 * (k - 3));
              GH_Panel myFormulaPanel = new GH_Panel();
              GrasshopperDocument.AddObject(myFormulaPanel, false);
              myFormulaPanel.Attributes.Pivot = new PointF(myCSGX - 800, myCSGY + 130 + 200 * (k - 3));
              myFormulaPanel.UserText = i.Split(' ')[k];
              myFormulaPanel.Attributes.Bounds = new RectangleF(0.0F, 0.0F, 100.0F, 20.0F);
              myFormulaPanel.Attributes.ExpireLayout();
              myFormula.Params.Input[4].AddSource(myFormulaPanel);
              myCSG.Params.Input[k - 1].AddSource(myFormula.Params.Output[0]);
              int myFormulaCount = 0;
              foreach (string item in Parameters.Keys)
              {
                if (i.Split(' ')[k].Contains(item))
                {
                  myFormula.Params.Input[myFormulaCount].AddSource(Parameters[item].Params.Output[0]);
                  myFormulaCount++;
                }
              }
              foreach(var item in OtherParameter.Params.Output)
              {
                if (i.Split(' ')[k].Contains(item.Name))
                {
                  myFormula.Params.Input[myFormulaCount].AddSource(item);
                  myFormulaCount++;
                }
              }
            }
          }
          CSGCount = CSGCount + 1;
        }
      }
      if (i.Contains("@Set_"))
      {
        break;
      }
    }
# ---------- deffileparser: C# additional code ----------
  public static List<string> GetDEFFileStrings(string DEFFilePath)
  {
    StreamReader DEFFileReader = new StreamReader(DEFFilePath);
    List < string > DEFFileStrings = new  List<string>(){};
    string Line;
    while ((Line = DEFFileReader.ReadLine()) != null)
    {
      DEFFileStrings.Add(Line);
    }
    DEFFileReader.Close();
    DEFFileStrings = DEFFileStrings.Select(i => Regex.Replace(i, @"\b\s+\b", " ")).ToList();
    return DEFFileStrings;
  }
  public static bool TextIsNumber(string Text)
  {
    decimal number = 0.2M;
    bool canConvert = decimal.TryParse(Text, out number);
    return canConvert;
  }
# ---------- end deffileparser ----------
deffileparser_2 = CSharpScript(Reference=["C:\Users\jinha\AppData\Roaming\Grasshopper\Libraries\SIM2DEF.gha", "C:\Users\jinha\AppData\Roaming\Grasshopper\Libraries\Debug\net48\TransmissionGIM23DM.gha"])  # -> A; inputs DEFFilePath: String
# ---------- deffileparser_2: C# ----------
    List < string > DEFFileString = GetDEFFileStrings(DEFFilePath);
    GH_Document GrasshopperDocument = Instances.ActiveCanvas.Document;
    int count1 = 0;
    Dictionary < string, TransmissionGIM23DM.Parameter > dict1 = new Dictionary < string, TransmissionGIM23DM.Parameter>(){};
    Dictionary < string, TransmissionGIM23DM.Position > dict2 = new Dictionary < string, TransmissionGIM23DM.Position>(){};
    Dictionary < string, TransmissionGIM23DM.Vector > dict3 = new Dictionary < string, TransmissionGIM23DM.Vector>(){};
    foreach(string i in DEFFileString)
    {
      if (i.StartsWith("@Param"))
      {
        float x = Convert.ToSingle(0);
        float y = Convert.ToSingle(100 * count1);
        TransmissionGIM23DM.Parameter g = new TransmissionGIM23DM.Parameter();
        GrasshopperDocument.AddObject(g, false);
        g.Attributes.Pivot = new PointF(x, y);
        g.Params.Input[0].NickName = i.Split(' ')[2];
        GH_Panel aPanel = new GH_Panel();
        GrasshopperDocument.AddObject(aPanel, false);
        aPanel.Attributes.Pivot = new PointF(x - 200, y - 10);
        aPanel.UserText = "1000";
        aPanel.Attributes.Bounds = new RectangleF(0.0F, 0.0F, 100.0F, 20.0F);
        aPanel.Attributes.ExpireLayout();
        g.Params.Input[0].AddSource(aPanel);
        dict1[i.Split(' ')[2]] = g;
        count1 = count1 + 1;
      }
    }
    float x_ = Convert.ToSingle(0);
    float y_ = Convert.ToSingle(100 * count1);
    TransmissionGIM23DM.InputPart2 g_ = new TransmissionGIM23DM.InputPart2();
    GrasshopperDocument.AddObject(g_, false);
    g_.Attributes.Pivot = new PointF(x_, y_ + 200);
    int count2 = 0;
    foreach(string i in DEFFileString)
    {
      if (i.StartsWith("@Define_Posi"))
      {
        List<string> ps = i.Split(' ').ToList();
        float x = Convert.ToSingle(1200);
        float y = Convert.ToSingle(700 * count2);
        TransmissionGIM23DM.Position g = new TransmissionGIM23DM.Position();
        GrasshopperDocument.AddObject(g, false);
        dict2[ps[1]] = g;
        g.Attributes.Pivot = new PointF(x, y);
        GH_Panel aPanel = new GH_Panel();
        GrasshopperDocument.AddObject(aPanel, false);
        aPanel.Attributes.Pivot = new PointF(x - 400, y - 40);
        aPanel.UserText = ps[1];
        aPanel.Attributes.Bounds = new RectangleF(0.0F, 0.0F, 100.0F, 20.0F);
        aPanel.Attributes.ExpireLayout();
        g.Params.Input[0].AddSource(aPanel);
        decimal numberx = 0;
        string numxString = ps[2];
        bool canConvertx = decimal.TryParse(numxString, out numberx);
        if (canConvertx == true)
        {
          Grasshopper.Kernel.Data.GH_Path dx = new Grasshopper.Kernel.Data.GH_Path(0);
          g.Params.Input[1].AddVolatileData(dx, 0, Convert.ToDouble(ps[2]));
        }
        else
        {
          TransmissionGIM23DM.Formula fx = new TransmissionGIM23DM.Formula();
          GrasshopperDocument.AddObject(fx, false);
          fx.Attributes.Pivot = new PointF(x - 400, y + 100);
          GH_Panel aPanelx = new GH_Panel();
          GrasshopperDocument.AddObject(aPanelx, false);
          aPanelx.Attributes.Pivot = new PointF(x - 800, y + 130);
          aPanelx.UserText = ps[2];
          aPanelx.Attributes.Bounds = new RectangleF(0.0F, 0.0F, 100.0F, 20.0F);
          aPanelx.Attributes.ExpireLayout();
          fx.Params.Input[4].AddSource(aPanelx);
          g.Params.Input[1].AddSource(fx.Params.Output[0]);
          int count_1 = 0;
          foreach (string item in dict1.Keys)
          {
            if (ps[2].Contains(item))
            {
              fx.Params.Input[count_1].AddSource(dict1[item].Params.Output[0]);
              count_1++;
            }
          }
          foreach(var item in g_.Params.Output)
          {
            if (ps[2].Contains(item.Name))
            {
              fx.Params.Input[count_1].AddSource(item);
              count_1++;
            }
          }
        }
        decimal numbery = 0.1M;
        string numyString = ps[3];
        bool canConverty = decimal.TryParse(numyString, out numbery);
        if (canConverty == true)
        {
          Grasshopper.Kernel.Data.GH_Path dy = new Grasshopper.Kernel.Data.GH_Path(0);
          g.Params.Input[2].AddVolatileData(dy, 0, Convert.ToDouble(ps[3]));
        }
        else
        {
          TransmissionGIM23DM.Formula fy = new TransmissionGIM23DM.Formula();
          GrasshopperDocument.AddObject(fy, false);
          fy.Attributes.Pivot = new PointF(x - 400, y + 300);
          GH_Panel aPanely = new GH_Panel();
          GrasshopperDocument.AddObject(aPanely, false);
          aPanely.Attributes.Pivot = new PointF(x - 800, y + 330);
          aPanely.UserText = ps[3];
          aPanely.Attributes.Bounds = new RectangleF(0.0F, 0.0F, 100.0F, 20.0F);
          aPanely.Attributes.ExpireLayout();
          fy.Params.Input[4].AddSource(aPanely);
          g.Params.Input[2].AddSource(fy.Params.Output[0]);
          int count_2 = 0;
          foreach (string item in dict1.Keys)
          {
            if (ps[3].Contains(item))
            {
              fy.Params.Input[count_2].AddSource(dict1[item].Params.Output[0]);
              count_2++;
            }
          }
          foreach(var item in g_.Params.Output)
          {
            if (ps[3].Contains(item.Name))
            {
              fy.Params.Input[count_2].AddSource(item);
              count_2++;
            }
          }
        }
        decimal numberz = 0.2M;
        string numzString = ps[4];
        bool canConvertz = decimal.TryParse(numzString, out numberz);
        if (canConvertz == true)
        {
          Grasshopper.Kernel.Data.GH_Path dz = new Grasshopper.Kernel.Data.GH_Path(0);
          g.Params.Input[3].AddVolatileData(dz, 0, Convert.ToDouble(ps[4]));
        }
        else
        {
          TransmissionGIM23DM.Formula fz = new TransmissionGIM23DM.Formula();
          GrasshopperDocument.AddObject(fz, false);
          fz.Attributes.Pivot = new PointF(x - 400, y + 500);
          GH_Panel aPanelz = new GH_Panel();
          GrasshopperDocument.AddObject(aPanelz, false);
          aPanelz.Attributes.Pivot = new PointF(x - 800, y + 530);
          aPanelz.UserText = ps[4];
          aPanelz.Attributes.Bounds = new RectangleF(0.0F, 0.0F, 100.0F, 20.0F);
          aPanelz.Attributes.ExpireLayout();
          fz.Params.Input[4].AddSource(aPanelz);
          g.Params.Input[3].AddSource(fz.Params.Output[0]);
          int count_3 = 0;
          foreach (string item in dict1.Keys)
          {
            if (ps[4].Contains(item))
            {
              fz.Params.Input[count_3].AddSource(dict1[item].Params.Output[0]);
              count_3++;
            }
          }
          foreach(var item in g_.Params.Output)
          {
            if (ps[4].Contains(item.Name))
            {
              fz.Params.Input[count_3].AddSource(item);
              count_3++;
            }
          }
        }
        count2 = count2 + 1;
      }
    }
    int count3 = 0;
    foreach(string i in DEFFileString)
    {
      if (i.StartsWith("@Define_Vect"))
      {
        List<string> ps = i.Split(' ').ToList();
        float x = Convert.ToSingle(2300);
        float y = Convert.ToSingle(300 * count3);
        TransmissionGIM23DM.Vector g = new TransmissionGIM23DM.Vector();
        GrasshopperDocument.AddObject(g, false);
        dict3[i.Split(' ')[1]] = g;
        g.Attributes.Pivot = new PointF(x, y);
        GH_Panel aPanel = new GH_Panel();
        GrasshopperDocument.AddObject(aPanel, false);
        aPanel.Attributes.Pivot = new PointF(x - 200, y - 70);
        aPanel.UserText = i.Split(' ')[1];
        aPanel.Attributes.Bounds = new RectangleF(0.0F, 0.0F, 100.0F, 20.0F);
        aPanel.Attributes.ExpireLayout();
        g.Params.Input[0].AddSource(aPanel);
        for(int k = 2; k < 8;k++)
        {
          if (ps[k].Contains("+"))
          {
            ps[k] = ps[k].Replace("+", "");
          }
          Grasshopper.Kernel.Data.GH_Path d_ = new Grasshopper.Kernel.Data.GH_Path(0);
          g.Params.Input[k - 1].AddVolatileData(d_, 0, Convert.ToDouble(ps[k]));
        }
        count3 = count3 + 1;
      }
    }
    int count4 = 0;
    foreach(string i in DEFFileString)
    {
      if (i.StartsWith("@Add_Cylinder"))
      {
        List<string> ps = i.Split(' ').ToList();
        float x = Convert.ToSingle(4300);
        float y = Convert.ToSingle(400 * count4);
        TransmissionGIM23DM.Cylinder g = new TransmissionGIM23DM.Cylinder();
        GrasshopperDocument.AddObject(g, false);
        g.Attributes.Pivot = new PointF(x, y);
        foreach (string item in dict2.Keys)
        {
          if (ps[1] == item)
          {
            g.Params.Input[0].AddSource(dict2[item].Params.Output[0]);
          }
        }
        foreach (string item in dict3.Keys)
        {
          if (ps[2] == item)
          {
            g.Params.Input[1].AddSource(dict3[item].Params.Output[0]);
          }
        }
        TransmissionGIM23DM.Formula f1 = new TransmissionGIM23DM.Formula();
        GrasshopperDocument.AddObject(f1, false);
        f1.Attributes.Pivot = new PointF(x - 400, y + 100);
        GH_Panel aPanel1 = new GH_Panel();
        GrasshopperDocument.AddObject(aPanel1, false);
        aPanel1.Attributes.Pivot = new PointF(x - 800, y + 130);
        aPanel1.UserText = ps[3];
        aPanel1.Attributes.Bounds = new RectangleF(0.0F, 0.0F, 100.0F, 20.0F);
        aPanel1.Attributes.ExpireLayout();
        f1.Params.Input[4].AddSource(aPanel1);
        g.Params.Input[2].AddSource(f1.Params.Output[0]);
        int count_3 = 0;
        foreach (string item in dict1.Keys)
        {
          if (ps[3].Contains(item))
          {
            f1.Params.Input[count_3].AddSource(dict1[item].Params.Output[0]);
            count_3++;
          }
        }
        foreach(var item in g_.Params.Output)
        {
          if (ps[3].Contains(item.Name))
          {
            f1.Params.Input[count_3].AddSource(item);
            count_3++;
          }
        }
        TransmissionGIM23DM.Formula f2 = new TransmissionGIM23DM.Formula();
        GrasshopperDocument.AddObject(f2, false);
        f2.Attributes.Pivot = new PointF(x - 400, y + 250);
        GH_Panel aPanel2 = new GH_Panel();
        GrasshopperDocument.AddObject(aPanel2, false);
        aPanel2.Attributes.Pivot = new PointF(x - 800, y + 280);
        aPanel2.UserText = ps[4];
        aPanel2.Attributes.Bounds = new RectangleF(0.0F, 0.0F, 100.0F, 20.0F);
        aPanel2.Attributes.ExpireLayout();
        f2.Params.Input[4].AddSource(aPanel2);
        g.Params.Input[3].AddSource(f2.Params.Output[0]);
        int count_4 = 0;
        foreach (string item in dict1.Keys)
        {
          if (ps[4].Contains(item))
          {
            f2.Params.Input[count_4].AddSource(dict1[item].Params.Output[0]);
            count_4++;
          }
        }
        foreach(var item in g_.Params.Output)
        {
          if (ps[4].Contains(item.Name))
          {
            f2.Params.Input[count_4].AddSource(item);
            count_4++;
          }
        }
        count4 = count4 + 1;
      }
    }
    A = DEFFileString;
# ---------- deffileparser_2: C# additional code ----------
  public static List<string> GetDEFFileStrings(string DEFFilePath)
  {
    StreamReader DEFFileReader = new StreamReader(DEFFilePath);
    List < string > DEFFileStrings = new  List<string>(){};
    string Line;
    while ((Line = DEFFileReader.ReadLine()) != null)
    {
      DEFFileStrings.Add(Line);
    }
    DEFFileReader.Close();
    DEFFileStrings = DEFFileStrings.Select(i => Regex.Replace(i, @"\b\s+\b", " ")).ToList();
    return DEFFileStrings;
  }
# ---------- end deffileparser_2 ----------
formula = Formula(X1=parameter.Param, X2=3.141592654, X3=3.141592654, X4=3.141592654, Formula="-A/2")
formula_2 = Formula(X1=parameter.Param, X2=3.141592654, X3=3.141592654, X4=3.141592654, Formula="A/2")
formula_3 = Formula(X1=parameter_2.Param, X2=3.141592654, X3=3.141592654, X4=3.141592654, Formula="B")
formula_4 = Formula(X1=inputpart.FHOD_1, X2=3.141592654, X3=3.141592654, X4=3.141592654, Formula="FHOD_1*1000*0.5")
formula_5 = Formula(X1=inputpart.FHOD_1, X2=3.141592654, X3=3.141592654, X4=3.141592654, Formula="FHOD_1*1000*0.5-5")
formula_6 = Formula(X1=inputpart.FHOD_1, X2=inputpart.FHT_1, X3=3.141592654, X4=3.141592654, Formula="FHOD_1*1000*0.5+FHT_1*1000*3")
formula_7 = Formula(X1=inputpart.FHOD_1, X2=3.141592654, X3=3.141592654, X4=3.141592654, Formula="FHOD_1*1000*0.6")
formula_8 = Formula(X1=inputpart.FHOD_1, X2=inputpart.FHT_1, X3=3.141592654, X4=3.141592654, Formula="FHOD_1*1000*0.5+FHT_1*1000*3")
formula_9 = Formula(X1=inputpart.FHOD_1, X2=3.141592654, X3=3.141592654, X4=3.141592654, Formula="-FHOD_1*1000*0.6")
formula_10 = Formula(X1=inputpart.FHOD_1, X2=inputpart.FHT_1, X3=3.141592654, X4=3.141592654, Formula="FHOD_1*1000*0.5+FHT_1*1000*3")
formula_11 = Formula(X1=parameter_2.Param, X2=3.141592654, X3=3.141592654, X4=3.141592654, Formula="B*0.24")
formula_12 = Formula(
    X1=parameter_2.Param,
    X2=inputpart.FHOD_1,
    X3=inputpart.FHT_1,
    X4=3.141592654,
    Formula="FHOD_1*1000*0.5+FHT_1*1000*3+B*0.45")
formula_13 = Formula(X1=parameter_2.Param, X2=3.141592654, X3=3.141592654, X4=3.141592654, Formula="-B*0.24")
formula_14 = Formula(
    X1=parameter_2.Param,
    X2=inputpart.FHOD_1,
    X3=inputpart.FHT_1,
    X4=3.141592654,
    Formula="FHOD_1*1000*0.5+FHT_1*1000*3+B*0.45")
formula_15 = Formula(X1=parameter_2.Param, X2=3.141592654, X3=3.141592654, X4=3.141592654, Formula="B")
formula_16 = Formula(X1=parameter_2.Param, X2=3.141592654, X3=3.141592654, X4=3.141592654, Formula="B-10")
formula_17 = Formula(X1=parameter.Param, X2=3.141592654, X3=3.141592654, X4=3.141592654, Formula="A*0.35")
position = Position(Name="ORI", X=0, Y=0, Z=0)  # -> Posi, Code
position_2 = Position(Name="PORT1", X=formula, Y=0, Z=0)  # -> Posi, Code
position_3 = Position(Name="PORT2", X=formula_2, Y=0, Z=0)  # -> Posi, Code
position_4 = Position(Name="P1", X=0, Y=0, Z=0)  # -> Posi, Code
position_5 = Position(Name="P2", X=0, Y=formula_3, Z=0)  # -> Posi, Code
position_6 = Position(Name="P3", X=0, Y=formula_4, Z=0)  # -> Posi, Code
position_7 = Position(Name="P4", X=0, Y=formula_5, Z=0)  # -> Posi, Code
position_8 = Position(Name="P5", X=0, Y=formula_6, Z=0)  # -> Posi, Code
position_9 = Position(Name="P6", X=formula_7, Y=formula_8, Z=0)  # -> Posi, Code
position_10 = Position(Name="P7", X=formula_9, Y=formula_10, Z=0)  # -> Posi, Code
position_11 = Position(Name="P8", X=formula_11, Y=formula_12, Z=0)  # -> Posi, Code
position_12 = Position(Name="P9", X=formula_13, Y=formula_14, Z=0)  # -> Posi, Code
position_13 = Position(Name="P10", X=0, Y=formula_15, Z=0)  # -> Posi, Code
position_14 = Position(Name="P11", X=0, Y=formula_16, Z=0)  # -> Posi, Code
position_15 = Position(Name="FP", X=0, Y=0, Z=formula_17)  # -> Posi, Code
vector = Vector(Name="+X", X1=0, Y1=0, Z1=0, X2=0, Y2=0, Z2=0)  # -> Vect, Code
vector_2 = Vector(Name="-X", X1=0, Y1=0, Z1=0, X2=0, Y2=0, Z2=0)  # -> Vect, Code
vector_3 = Vector(Name="+Y", X1=0, Y1=0, Z1=0, X2=0, Y2=0, Z2=0)  # -> Vect, Code
vector_4 = Vector(Name="-Y", X1=0, Y1=0, Z1=0, X2=0, Y2=0, Z2=0)  # -> Vect, Code
vector_5 = Vector(Name="+Z", X1=0, Y1=0, Z1=0, X2=0, Y2=0, Z2=0)  # -> Vect, Code
vector_6 = Vector(Name="-Z", X1=0, Y1=0, Z1=0, X2=0, Y2=0, Z2=0)  # -> Vect, Code
vector_7 = Vector(Name="+X1", X1=0, Y1=0, Z1=0, X2=0, Y2=0, Z2=0)  # -> Vect, Code
vector_8 = Vector(Name="-X1", X1=0, Y1=0, Z1=0, X2=0, Y2=0, Z2=0)  # -> Vect, Code
formula_18 = Formula(X1=inputpart.FHOD_1, X2=3.141592654, X3=3.141592654, X4=3.141592654, Formula="FHOD_1*1000*0.5")
formula_19 = Formula(X1=inputpart.FHT_1, X2=3.141592654, X3=3.141592654, X4=3.141592654, Formula="FHT_1*1000")
formula_20 = Formula(X1=inputpart.FHOD_2, X2=3.141592654, X3=3.141592654, X4=3.141592654, Formula="FHOD_2*1000*0.5")
formula_21 = Formula(X1=inputpart.FHT_2, X2=3.141592654, X3=3.141592654, X4=3.141592654, Formula="FHT_2*1000")
formula_22 = Formula(X1=parameter.Param, X2=3.141592654, X3=3.141592654, X4=3.141592654, Formula="A*0.25")
formula_23 = Formula(X1=inputpart.POD_1, X2=3.141592654, X3=3.141592654, X4=3.141592654, Formula="POD_1*1000/2")
formula_24 = Formula(X1=parameter.Param, X2=3.141592654, X3=3.141592654, X4=3.141592654, Formula="A*0.25")
formula_25 = Formula(X1=parameter.Param, X2=3.141592654, X3=3.141592654, X4=3.141592654, Formula="A/2")
formula_26 = Formula(X1=inputpart.POD_2, X2=3.141592654, X3=3.141592654, X4=3.141592654, Formula="POD_2*1000/2")
formula_27 = Formula(X1=parameter.Param, X2=3.141592654, X3=3.141592654, X4=3.141592654, Formula="A*0.25")
formula_28 = Formula(X1=parameter.Param, X2=3.141592654, X3=3.141592654, X4=3.141592654, Formula="A/2")
formula_29 = Formula(X1=parameter.Param, X2=3.141592654, X3=3.141592654, X4=3.141592654, Formula="A*0.25")
formula_30 = Formula(X1=parameter_2.Param, X2=3.141592654, X3=3.141592654, X4=3.141592654, Formula="B*0.3")
formula_31 = Formula(X1=parameter.Param, X2=3.141592654, X3=3.141592654, X4=3.141592654, Formula="A*0.3")
formula_32 = Formula(X1=inputpart.FHT_1, X2=3.141592654, X3=3.141592654, X4=3.141592654, Formula="FHT_1*1000")
formula_33 = Formula(X1=parameter.Param, X2=3.141592654, X3=3.141592654, X4=3.141592654, Formula="A*0.2")
formula_34 = Formula(X1=parameter.Param, X2=3.141592654, X3=3.141592654, X4=3.141592654, Formula="A*0.1")
formula_35 = Formula(X1=inputpart.FHT_1, X2=3.141592654, X3=3.141592654, X4=3.141592654, Formula="FHT_1*1000*4")
formula_36 = Formula(X1=inputpart.FHT_1, X2=3.141592654, X3=3.141592654, X4=3.141592654, Formula="FHT_1*1000")
formula_37 = Formula(X1=inputpart.FHOD_1, X2=3.141592654, X3=3.141592654, X4=3.141592654, Formula="FHOD_1*1000*0.6")
formula_38 = Formula(X1=inputpart.FHT_1, X2=3.141592654, X3=3.141592654, X4=3.141592654, Formula="FHT_1*1000")
formula_39 = Formula(X1=inputpart.FHOD_1, X2=3.141592654, X3=3.141592654, X4=3.141592654, Formula="FHOD_1*1000*0.6")
formula_40 = Formula(X1=inputpart.FHT_1, X2=3.141592654, X3=3.141592654, X4=3.141592654, Formula="FHT_1*1000")
formula_41 = Formula(X1=parameter_2.Param, X2=3.141592654, X3=3.141592654, X4=3.141592654, Formula="B*0.5")
formula_42 = Formula(X1=inputpart.FHT_1, X2=3.141592654, X3=3.141592654, X4=3.141592654, Formula="FHT_1*1000")
formula_43 = Formula(X1=parameter_2.Param, X2=3.141592654, X3=3.141592654, X4=3.141592654, Formula="B*0.45")
formula_44 = Formula(X1=inputpart.FHT_1, X2=3.141592654, X3=3.141592654, X4=3.141592654, Formula="FHT_1*1000")
formula_45 = Formula(X1=parameter_2.Param, X2=3.141592654, X3=3.141592654, X4=3.141592654, Formula="B*0.45")
formula_46 = Formula(X1=inputpart.FHT_1, X2=3.141592654, X3=3.141592654, X4=3.141592654, Formula="FHT_1*1000")
formula_47 = Formula(X1=inputpart.FHT_1, X2=3.141592654, X3=3.141592654, X4=3.141592654, Formula="FHT_1*1000")
formula_48 = Formula(X1=inputpart.FHT_1, X2=3.141592654, X3=3.141592654, X4=3.141592654, Formula="FHT_1*1000")
formula_49 = Formula(X1=parameter.Param, X2=3.141592654, X3=3.141592654, X4=3.141592654, Formula="A*0.125")
formula_50 = Formula(X1=parameter_2.Param, X2=3.141592654, X3=3.141592654, X4=3.141592654, Formula="B*0.25")
formula_51 = Formula(X1=parameter_3.Param, X2=3.141592654, X3=3.141592654, X4=3.141592654, Formula="C*0.5")
formula_52 = Formula(X1=inputpart.FHT_1, X2=3.141592654, X3=3.141592654, X4=3.141592654, Formula="FHT_1*1000")
cone = Cone(Posi=position_2.Posi, Vector=vector.Vect, BottomRadius=formula_23, TopRadius=formula_24, Height=formula_25)  # -> Cone, Code
cone_2 = Cone(Posi=position_3.Posi, Vector=vector_2.Vect, BottomRadius=formula_26, TopRadius=formula_27, Height=formula_28)  # -> Cone, Code
cone_3 = Cone(Posi=position_6.Posi, Vector=vector_3.Vect, BottomRadius=formula_33, TopRadius=formula_34, Height=formula_35)  # -> Cone, Code
cylinder = Cylinder(Posi=position_2.Posi, Vector=vector.Vect, Radius=formula_18, Length=formula_19)  # -> Cylinder, DEFCode, TribonCode
cylinder_2 = Cylinder(Posi=position_3.Posi, Vector=vector_2.Vect, Radius=formula_20, Length=formula_21)  # -> Cylinder, DEFCode, TribonCode
cylinder_3 = Cylinder(Posi=position_4.Posi, Vector=vector_3.Vect, Radius=formula_29, Length=formula_30)  # -> Cylinder, DEFCode, TribonCode
cylinder_4 = Cylinder(Posi=position_7.Posi, Vector=vector_4.Vect, Radius=formula_31, Length=formula_32)  # -> Cylinder, DEFCode, TribonCode
cylinder_5 = Cylinder(Posi=position_8.Posi, Vector=vector.Vect, Radius=formula_36, Length=formula_37)  # -> Cylinder, DEFCode, TribonCode
cylinder_6 = Cylinder(Posi=position_8.Posi, Vector=vector_2.Vect, Radius=formula_38, Length=formula_39)  # -> Cylinder, DEFCode, TribonCode
cylinder_7 = Cylinder(Posi=position_8.Posi, Vector=vector_3.Vect, Radius=formula_40, Length=formula_41)  # -> Cylinder, DEFCode, TribonCode
cylinder_8 = Cylinder(Posi=position_9.Posi, Vector=vector_7.Vect, Radius=formula_42, Length=formula_43)  # -> Cylinder, DEFCode, TribonCode
cylinder_9 = Cylinder(Posi=position_10.Posi, Vector=vector_8.Vect, Radius=formula_44, Length=formula_45)  # -> Cylinder, DEFCode, TribonCode
cylinder_10 = Cylinder(Posi=position_13.Posi, Vector=vector_4.Vect, Radius=formula_49, Length=formula_50)  # -> Cylinder, DEFCode, TribonCode
cylinder_11 = Cylinder(Posi=position_14.Posi, Vector=vector_4.Vect, Radius=formula_51, Length=formula_52)  # -> Cylinder, DEFCode, TribonCode
sphere = Sphere(Posi=position.Posi, Vector=vector_4.Vect, Radius=formula_22)  # -> Sphere, Code
sphere_2 = Sphere(Posi=position_9.Posi, Vector=vector_4.Vect, Radius=formula_46)  # -> Sphere, Code
sphere_3 = Sphere(Posi=position_11.Posi, Vector=vector_4.Vect, Radius=formula_47)  # -> Sphere, Code
sphere_4 = Sphere(Posi=position_12.Posi, Vector=vector_4.Vect, Radius=formula_48)  # -> Sphere, Code
