# Grasshopper definition Valve.ghx (Grasshopper 1.0.7)
# plug-ins: Components

R = Slider(300, range=0..1000)
H = Slider(1000, range=0..1000)
N = Slider(10, range=0..10)
paras = Paras(D1=R, D2=H, D3=N, D4=0, D5=0, D6=0, D7=0, D8=0, D9=0, D10=0, D11=0, D12=0)  # -> D1, D2, D3, D4, D5, D6, D7, D8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
cylinder = Cylinder(Radius=paras.D1, Height=paras.D2)
formula = Formula(Parameter=paras.D1, Formula="x1/3")
formula_2 = Formula(Parameter=paras.D1, Formula="x1/3")
formula_3 = Formula(Parameter=paras.D2, Formula="x1*2")
formula_4 = Formula(Parameter=paras.D1, Formula="x1*3")
formula_5 = Formula(Parameter=paras.D2, Formula="x1/10")
cylinder_2 = Cylinder(Radius=formula, Height=formula_4)
ring = Ring(SmallerRadius=formula, BiggerRadius=formula_4, Angle=360)
cone = Cone(BottomRadius=paras.D1, TopRadius=formula_2, Height=formula_3)
formula_6 = Formula(Parameter=paras.D2, Formula="x1/2")
cylinder_3 = Cylinder(Radius=formula_4, Height=formula_5)
xyz2list = XYZ2List(X=0, Y=0, Z=formula_6)
xyz2list_2 = XYZ2List(X=0, Y=0, Z=paras.D2)
yaxis = YAxis()
angle = Slider(180, range=0..1000)
move = Move(Brep=cone, Move=xyz2list)
move_2 = Move(Brep=cylinder_3, Move=xyz2list_2)
rotate = Rotate(Brep=cylinder_3, RotateOrigin=[0, 0, 0], RotateAxis=yaxis, RotateAngle=angle)
yaxis_2 = YAxis()
rotate_2 = Rotate(Brep=move, RotateOrigin=xyz2list, RotateAxis=yaxis_2, RotateAngle=90)
faceindex = Slider(2, range=0..5)
sphere = Sphere(Radius=formula_2)
getfeature = GetFeature(Brep=rotate_2, FaceIndex=faceindex, EdgeIndex=-1, VertexIndex=-1)  # -> Face, FaceCenterOfMass, FaceNormal, Edge, EdgeStartVertex, EdgeEndVertex, EdgeMidVertex, EdgeNormal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
circlearray = CircleArray(N=paras.D3)
move_3 = Move(Brep=cylinder_2, Move=getfeature.FaceCenterOfMass)
move_4 = Move(Brep=ring, Move=getfeature.FaceCenterOfMass)
move_5 = Move(Brep=sphere, Move=getfeature.FaceCenterOfMass)
xaxis = XAxis()
yaxis_3 = YAxis()
rotate_3 = Rotate(Brep=move_3, RotateOrigin=getfeature.FaceCenterOfMass, RotateAxis=xaxis, RotateAngle=circlearray)
rotate_4 = Rotate(Brep=move_4, RotateOrigin=getfeature.FaceCenterOfMass, RotateAxis=yaxis_3, RotateAngle=90)
panel = Panel("""名称=铸钢对夹刀闸阀
口径范围=DN50-DN40
公称压力=PN10
适用温度=0℃~80℃
适用介质=污水、煤浆、灰、渣水混合物
阀体材质=WCB
应用领域=化学、水处理、煤电厂、食品、造纸、石油
阀体=DI/WCB/CF3/CF3M/CF8/CF8M
阀座密封=橡胶／四氟/不锈钢/硬质合金／PTFE
阀板=WCB/201/CF3/CF3M/CF8/CF8M
阀轴=Q235/201/CF3/CF3M/CF8/CF8M
执行器=手轮/涡轮/电动/气动""")
header = Header(GUID="3f7a44d4-cee7-40af-977a-8c13e32baf3f", Name="闸阀", Version="V1.0", Description="闸阀", DateTime="12/04/2022 23:35:55")
attribute = ATTRIBUTE(Panel=panel)
sim = SIM(COMMENT="闸阀", HEADER=header, PARAMETER="""[PARAMETER]
[ENDPARAMETER]""", ATTRIBUTE=attribute)
panel_2 = Panel(sim)
